# Grasshopper definition lampBase.gh (Grasshopper 1.0.8)

base_width_top = Slider(51.3, range=0..100)
base_width_bottom = Slider(55.1, range=0..100)
# Making the bottom shape of the stand
xy = XYPlane(Origin=Point(0, 0, 0))
base_height = Slider(13.9, range=0..100)
cir = Circle(Plane=PlaneXY(0, 0, 0), Radius=base_width_top)
vec = VectorXYZ(XComponent=0, YComponent=0, ZComponent=base_height)  # -> Vector, Length
cir_2 = Circle(Plane=xy, Radius=base_width_bottom)
move = Move(Geometry=cir, Motion=vec.Vector)  # -> Geometry, Transform
loft = Loft(
    Curves=[cir_2, move.Geometry],
    Options={Adjust=False, Closed=False, LoftEnds=0, LoftSimp=0, LoftType=0, Rebuild=10, Refit=0.01})

# ----
# creating the middle of the stand
width_of_stand = Slider(26.7, range=0..100)
stand_height = Slider(52.1, range=0..100)
cir_3 = Circle(Plane=xy, Radius=width_of_stand)
vec_2 = VectorXYZ(XComponent=0, YComponent=0, ZComponent=base_height)  # -> Vector, Length
cir_4 = Circle(Plane=PlaneXY(0, 0, 0), Radius=width_of_stand)
vec_3 = VectorXYZ(XComponent=0, YComponent=0, ZComponent=stand_height)  # -> Vector, Length
move_2 = Move(Geometry=cir_3, Motion=vec_2.Vector)  # -> Geometry, Transform
move_3 = Move(Geometry=cir_4, Motion=vec_3.Vector)  # -> Geometry, Transform
loft_2 = Loft(
    Curves=[move_2.Geometry, move_3.Geometry],
    Options={Adjust=False, Closed=False, LoftEnds=0, LoftSimp=0, LoftType=0, Rebuild=10, Refit=0.01})

# ----
# Creating notch for wire to feed through at the bottom
number_slider = Slider(-1, range=-1..10)
number_slider_2 = Slider(-52, range=-100..10)
xz = XZPlane(Origin=Point(0, 0, 0))
multiplication = Multiplication(A=base_width_bottom, B=number_slider)
cir_5 = Circle(Plane=xz, Radius=Slider(2.4, range=0..10))
vec_4 = VectorXYZ(XComponent=0, YComponent=multiplication, ZComponent=0)  # -> Vector, Length
move_4 = Move(Geometry=cir_5, Motion=vec_4.Vector)  # -> Geometry, Transform
pull = PullCurve(Curve=move_4.Geometry, Surface=loft)
srfsplit = SurfaceSplit(Surface=loft, Curves=pull)
item = ListItem(List=srfsplit, Index=Slider(0, range=0..100), Wrap=True)

# ----
# connecting the base with the middle
loft_3 = Loft(
    Curves=[move.Geometry, move_2.Geometry],
    Options={Adjust=False, Closed=False, LoftEnds=0, LoftSimp=0, LoftType=0, Rebuild=10, Refit=0.01})

# ----
# Creating place for bulb socket to sit (diameter will change when we get the final dimensions of the socket)
bulb_base_diameter_in_mm = Slider(26, range=0..100)
multiplication_2 = Multiplication(A=Slider(0.5, range=0..1), B=bulb_base_diameter_in_mm)
cir_6 = Circle(Plane=PlaneXY(0, 0, 0), Radius=multiplication_2)
move_5 = Move(Geometry=cir_6, Motion=vec_3.Vector)  # -> Geometry, Transform
loft_4 = Loft(
    Curves=[move_3.Geometry, move_5.Geometry],
    Options={Adjust=False, Closed=False, LoftEnds=0, LoftSimp=0, LoftType=0, Rebuild=10, Refit=0.01})
