# Grasshopper definition lampshade_360_slicer.gh (Grasshopper 1.0.8)

# ----
# setting up the base shape
number_slider = Slider(58, range=0..100)
height = Slider(255, range=0..500)
base_width = Slider(24, range=0..200)
circle = Circle(Plane=PlaneXY(0, 0, 0), Radius=number_slider)
circle_2 = Circle(Plane=PlaneXY(0, 0, 0), Radius=base_width)
vector_xyz = VectorXYZ(XComponent=0, YComponent=0, ZComponent=height)  # -> Vector, Length
move = Move(Geometry=circle_2, Motion=vector_xyz.Vector)  # -> Geometry, Transform
area = Area(Geometry=move.Geometry)  # -> Area, Centroid
area_2 = Area(Geometry=circle)  # -> Area, Centroid
line = Line(StartPoint=area.Centroid, EndPoint=area_2.Centroid)
point_on_curve = PointOnCurve(line, parameter=0.75)
point_on_curve_2 = PointOnCurve(line, parameter=0.5)
point_on_curve_3 = PointOnCurve(line, parameter=0.25)
circle_3 = Circle(Plane=point_on_curve_3, Radius=Slider(24, range=0..200))
circle_4 = Circle(Plane=point_on_curve, Radius=Slider(24, range=0..200))
circle_5 = Circle(Plane=point_on_curve_2, Radius=Slider(75, range=0..200))
loft = Loft(
    Curves=[move.Geometry, circle_3, circle_5, circle_4, circle],
    Options={Adjust=False, Closed=False, LoftEnds=0, LoftSimp=0, LoftType=0, Rebuild=10, Refit=0.01})

vector_xyz_2 = VectorXYZ(XComponent=0, YComponent=0, ZComponent=height)  # -> Vector, Length
vector_xyz_3 = VectorXYZ(XComponent=0, YComponent=0, ZComponent=0)  # -> Vector, Length
point = Point(vector_xyz_3.Vector)
point_2 = Point(vector_xyz_2.Vector)
line_2 = Line(StartPoint=point_2, EndPoint=point)
twist = Twist(Geometry=loft, Axis=line_2, Angle=Slider(0, range=0..2.5), Infinite=False, Rigid=False)
panel = Panel("twist")
cap_holes = CapHoles(Brep=twist)
merge = Merge(Data1=cap_holes)

# ----
# mapping slices to xy plane
number_slider_2 = Slider(215, range=0..300)
construct_domain = ConstructDomain(DomainStart=number_slider_2, DomainEnd=Slider(3019, range=0..4000))
range = Range(Domain=construct_domain, Steps=Slider(10, range=0..20))
unit_x = UnitX(Factor=range)
xy_plane = XYPlane(Origin=Point(0, 0, 0))
move_2 = Move(Geometry=xy_plane, Motion=unit_x)  # -> Geometry, Transform
area_3 = Area(Geometry=move_2.Geometry)  # -> Area, Centroid

panel_2 = Panel("inner shape")
number_slider_3 = Slider(0.7, range=0..1)
scale_nu = ScaleNU(Geometry=twist, Plane=PlaneXY(0, 0, 0), ScaleX=number_slider_3, ScaleY=number_slider_3, ScaleZ=1)  # -> Geometry, Transform
cap_holes_2 = CapHoles(Brep=scale_nu.Geometry)
merge_2 = Merge(Data1=cap_holes_2)

division = Division(A=Slider(360, range=0..1000), B=Slider(18, range=0..50))
series = Series(Start=0, Step=division, Count=10)
multiplication = Multiplication(A=division, B=Slider(-1, range=-1..10))
radians = Radians(Degrees=series)
series_2 = Series(Start=0, Step=multiplication, Count=10)
panel_3 = Panel("slicing algorithm/outer contours")
yz_plane = YZPlane(Origin=Point(0, 0, 0))
rotate = Rotate(Geometry=yz_plane, Angle=radians, Plane=PlaneXY(0, 0, 0))  # -> Geometry, Transform
radians_2 = Radians(Degrees=series_2)
brep_plane = BrepPlane(Brep=merge, Plane=rotate.Geometry)  # -> flatten(Curves), Points
orient = Orient(Geometry=brep_plane.Curves, Source=yz_plane, Target=move_2.Geometry)  # -> Geometry, Transform
unit_y = UnitY(Factor=1)
rotate_3d = Rotate3D(Geometry=orient.Geometry, Angle=radians_2, Center=area_3.Centroid, Axis=unit_y)  # -> Geometry, Transform

brep_plane_2 = BrepPlane(Brep=merge_2, Plane=rotate.Geometry)  # -> flatten(Curves), Points
orient_2 = Orient(Geometry=brep_plane_2.Curves, Source=yz_plane, Target=move_2.Geometry)  # -> Geometry, Transform
panel_4 = Panel("inner contours")
rotate_3d_2 = Rotate3D(Geometry=orient_2.Geometry, Angle=radians_2, Center=area_3.Centroid, Axis=unit_y)  # -> Geometry, Transform

explode = Explode(Curve=rotate_3d.Geometry, Recursive=True)  # -> Segments, Vertices
list_length = ListLength(List=rotate_3d.Geometry)
panel_5 = Panel("display text")
number_slider_4 = Slider(7, range=0..50)
series_3 = Series(Start=Slider(1, range=0..1), Step=1, Count=list_length)
list_item = ListItem(List=explode.Segments, Index=0, Wrap=True)  # -> flatten(Item)
list_item_2 = ListItem(List=explode.Segments, Index=Slider(2, range=0..10), Wrap=True)  # -> flatten(Item)
text_tag_3d = TextTag3D(Location=list_item, Text=series_3, Size=number_slider_4, Justification=7)
text_tag_3d_2 = TextTag3D(Location=list_item_2, Text=series_3, Size=number_slider_4, Justification=7)
