# Grasshopper definition lampshade_vertical_slicer.gh (Grasshopper 1.0.8)

amount_of_sides = Slider(5, range=0..10)
top_width = Slider(70, range=0..200)
base_width = Slider(75, range=0..200)
height = Slider(190, range=0..500)
center_width = Slider(75, range=0..200)
shape_spacing = Slider(25, range=0..200)

# ----
# mapping slices to xy plane
number_slider = Slider(1762, range=0..4000)
dom = ConstructDomain(DomainStart=Slider(215, range=0..300), DomainEnd=number_slider)
range = Range(Domain=dom, Steps=Slider(10, range=0..20))
xy = XYPlane(Origin=Point(0, 0, 0))
X = UnitX(Factor=range)
move = Move(Geometry=xy, Motion=X)  # -> Geometry, Transform

# ----
# setting up the base shape
vec = VectorXYZ(XComponent=0, YComponent=0, ZComponent=height)  # -> Vector, Length
polygon = Polygon(Plane=PlaneXY(0, 0, 0), Radius=top_width, Segments=amount_of_sides, FilletRadius=0)  # -> Polygon, Length
polygon_2 = Polygon(Plane=PlaneXY(0, 0, 0), Radius=center_width, Segments=amount_of_sides, FilletRadius=0)  # -> Polygon, Length
polygon_3 = Polygon(Plane=PlaneXY(0, 0, 0), Radius=base_width, Segments=amount_of_sides, FilletRadius=0)  # -> Polygon, Length
vec_2 = VectorXYZ(XComponent=0, YComponent=0, ZComponent=shape_spacing)  # -> Vector, Length
move_2 = Move(Geometry=polygon.Polygon, Motion=vec.Vector)  # -> Geometry, Transform
move_3 = Move(Geometry=polygon_2.Polygon, Motion=vec_2.Vector)  # -> Geometry, Transform
loft = Loft(
    Curves=[move_2.Geometry, move_3.Geometry, polygon_3.Polygon],
    Options={Adjust=False, Closed=False, LoftEnds=0, LoftSimp=0, LoftType=0, Rebuild=10, Refit=0.01})

vec_3 = VectorXYZ(XComponent=0, YComponent=0, ZComponent=height)  # -> Vector, Length
vec_4 = VectorXYZ(XComponent=0, YComponent=0, ZComponent=0)  # -> Vector, Length
pt = Point(vec_4.Vector)
pt_2 = Point(vec_3.Vector)
ln = Line(StartPoint=pt_2, EndPoint=pt)
panel = Panel("twist")
twist = Twist(Geometry=loft, Axis=ln, Angle=Slider(0, range=0..2.5), Infinite=False, Rigid=False)

number_slider_2 = Slider(0.9, range=0..1)
number_slider_3 = Slider(0, range=0..100)
cap_holes = CapHoles(Brep=twist)
scale_nu = ScaleNU(Geometry=twist, Plane=PlaneXY(0, 0, 0), ScaleX=number_slider_2, ScaleY=number_slider_2, ScaleZ=1)  # -> Geometry, Transform
merge = Merge(Data1=cap_holes)
construct_point = ConstructPoint(XCoordinate=number_slider_3, YCoordinate=number_slider_3, ZCoordinate=number_slider_3)
cap_holes_2 = CapHoles(Brep=scale_nu.Geometry)
unit_x = UnitX(Factor=1)
merge_2 = Merge(Data1=cap_holes_2)
number_slider_4 = Slider(0, range=0..100)
contour = Contour(Shape=merge, Point=construct_point, Direction=unit_x, Distance=Slider(16, range=0..100))  # -> flatten(Contours)
yz_plane = YZPlane(Origin=Point(0, 0, 0))
construct_point_2 = ConstructPoint(XCoordinate=number_slider_4, YCoordinate=number_slider_4, ZCoordinate=number_slider_4)
orient = Orient(Geometry=contour, Source=yz_plane, Target=move.Geometry)  # -> Geometry, Transform
unit_x_2 = UnitX(Factor=1)
projecta = ProjectAlong(Geometry=orient.Geometry, Plane=PlaneXY(0, 0, 0), Direction=Vector(0, 0, -1))  # -> Geometry, Transform
contour_2 = Contour(Shape=merge_2, Point=construct_point_2, Direction=unit_x_2, Distance=Slider(16, range=0..100))  # -> flatten(Contours)
yz_plane_2 = YZPlane(Origin=Point(0, 0, 0))
panel_2 = Panel("2d Slicing Algorithm")
lng = ListLength(List=projecta.Geometry)
orient_2 = Orient(Geometry=contour_2, Source=yz_plane_2, Target=move.Geometry)  # -> Geometry, Transform
series = Series(Start=Slider(1, range=0..1), Step=1, Count=lng)
projecta_2 = ProjectAlong(Geometry=orient_2.Geometry, Plane=PlaneXY(0, 0, 0), Direction=Vector(0, 0, -1))  # -> Geometry, Transform
text_tag_3d = TextTag3D(Location=projecta.Geometry, Text=series, Size=Slider(3, range=0..10), Justification=7)
